# Dynamo graph write paramer in scope box.dyn (Dynamo 2.19.3.6394)

categories = Categories("OST_SpecialityEquipment")
all_elements_of_category = ElementsOfCategory(Category=categories)
parameter_for_write = StringInput("Comments")
value = StringInput("7")
filter_paramer = StringInput("Mark")
value_filter_parameter = StringInput("777")
python_script = Python(Category_element=all_elements_of_category, Parameter_for_write=parameter_for_write, value=value, Filter_parameter=filter_paramer, Value_filter_parameter=value_filter_parameter)  # CPython3; unwired: Scope_box
# ---------- python_script.python (94 lines) ----------
import clr
clr.AddReference('RevitAPI')
from Autodesk.Revit.DB import *

clr.AddReference('RevitServices')
import RevitServices
from RevitServices.Persistence import DocumentManager
from RevitServices.Transactions import TransactionManager

doc = DocumentManager.Instance.CurrentDBDocument

# Розпакування всіх 6 входів з Dynamo
scope_box_raw, input_elements_raw, param_to_set, value_to_set, filter_param_name, filter_value = IN

scope_box = UnwrapElement(scope_box_raw)
input_elements = UnwrapElement(input_elements_raw)

# Захист від None та поодиноких елементів
if input_elements is None:
    elements = []
elif isinstance(input_elements, list):
    elements = input_elements
else:
    elements = [input_elements]

# Отримуємо Bounding Box від Scope Box
view = FilteredElementCollector(doc).OfClass(ViewPlan).FirstElement()
bbox = scope_box.get_BoundingBox(view)
outline = Outline(bbox.Min, bbox.Max)

updated_count = 0

# Визначаємо режим фільтрації
# Якщо фільтр-значення порожнє, переходимо в режим перевірки на заповненість
check_only_if_filled = filter_value is None or str(filter_value).strip() == ""

# Відкриваємо транзакцію для запису в Revit
TransactionManager.Instance.EnsureInTransaction(doc)

for el in elements:
    if el is None:
        continue
        
    # 1. ПЕРЕВІРКА НАЯВНОСТІ ПАРАМЕТРА
    f_param = el.LookupParameter(filter_param_name)
    if not f_param or not f_param.HasValue:
        continue # Пропускаємо, якщо параметра взагалі немає або він пустий за дефолтом
        
    # Зчитуємо значення параметра як текст
    current_val_str = f_param.AsValueString() if f_param.StorageType == StorageType.ElementId else f_param.AsString()
    
    if current_val_str is None:
        if f_param.StorageType == StorageType.Integer:
            current_val_str = str(f_param.AsInteger())
        elif f_param.StorageType == StorageType.Double:
            current_val_str = UnitUtils.ConvertFromInternalUnits(f_param.AsDouble(), f_param.GetUnitTypeId()) if hasattr(f_param, "GetUnitTypeId") else str(f_param.AsDouble())
        else:
            current_val_str = ""

    # Додаткова перевірка на порожній рядок
    if current_val_str.strip() == "":
        continue

    # 2. ФІЛЬТРАЦІЯ ЗА РЕЖИМАМИ
    if not check_only_if_filled:
        # Режим А: Шукаємо конкретне значення (ігноруючи регістр)
        current_val_clean = current_val_str.lower().strip()
        search_val_clean = str(filter_value).lower().strip()
        
        if search_val_clean not in current_val_clean:
            continue # Не збігається — пропускаємо
    # Режим Б: Якщо check_only_if_filled == True, ми сюди навіть не заходимо, 
    # бо елемент уже пройшов перевірку на те, що він не пустий вище.

    # 3. ГЕОМЕТРИЧНА ПЕРЕВІРКА (SCOPE BOX)
    el_bbox = el.get_BoundingBox(None)
    if el_bbox is None:
        continue
        
    if outline.Contains(el_bbox.Min, 0.001) or outline.Contains(el_bbox.Max, 0.001):
        # 4. ЗАПИС НОВОГО ЗНАЧЕННЯ
        p = el.LookupParameter(param_to_set)
        if p and not p.IsReadOnly:
            if isinstance(value_to_set, int):
                p.Set(value_to_set)
            elif isinstance(value_to_set, float):
                p.Set(value_to_set)
            else:
                p.Set(str(value_to_set))
            updated_count += 1

TransactionManager.Instance.TransactionTaskDone()

OUT = "Успішно оброблено та оновлено елементів: {}".format(updated_count)
# ----------------------------------------
scope_box = DSModelElementSelection()  # 1 picked in the model
name = Element.Name(element=scope_box)
